# Dynamo graph IFC Archiver.dyn (Dynamo 1.3.2.2480)

# group: time setting part for IFC exports
now = DateTime.Now()
time_setting_for_ifc_export = CodeBlock(now)  # unwired: arg1, arg2
# ---------- time_setting_for_ifc_export.designscript (21 lines) ----------
time;

tCount;
t0;
[Imperative]
{
 if(t0 == null)
 {
  t0=time;
 }
 if(tCount == null)
 {
  tCount=0;

 }else
 {
  tCount = tCount + 1;
  t0 = time;
 }
 return = tCount;
};
# ----------------------------------------
counter_of_the_time_unit_for = CodeBlock { 2; }  # "Counter of the time unit for export (time unit = 2 seconds)"
python_script = Python(IN[0]=time_setting_for_ifc_export.out3, IN[1]=counter_of_the_time_unit_for, IN[2]=time_setting_for_ifc_export.out0)
# ---------- python_script.python (11 lines) ----------
import clr
clr.AddReference('ProtoGeometry')
from Autodesk.DesignScript.Geometry import *
#The inputs to this node will be stored as a list in the IN variables.
dataEnteringNode = IN

#Assign your output to the OUT variable.
if IN[0] % IN[1] == 1:
	OUT = [IN[2], IN[2], 'true']
else:
	OUT = [IN[2], 'false', 'false']
# ----------------------------------------
watch = Watch(python_script)
watch_2 = Watch(time_setting_for_ifc_export.out3)
string_from_object = FromObject(now)
watch_3 = Watch(string_from_object)

code_block = CodeBlock(t=watch) { t[0]; t[1]; t[2]; }

# group: the process of setting now.time as a string format to be used for the names of IFC files
string_from_object_2 = FromObject(code_block.out1)
watch_4 = Watch(string_from_object_2)
string = StringInput(":")
string_2 = StringInput(" ")
split = String.Split(watch_4, string, string_2)
watch_5 = Watch(split)
python_script_2 = Python(IN[0]=watch_5)
# ---------- python_script_2.python (14 lines) ----------
import clr
clr.AddReference('ProtoGeometry')
from Autodesk.DesignScript.Geometry import *
#The inputs to this node will be stored as a list in the IN variables.
dataEnteringNode = IN

#Assign your output to the OUT variable.
if IN[0][-1] == 'PM' and IN[0][-4] != "12":
	
	a=int(IN[0][1]) + 12
else:
	a=int(IN[0][1])

OUT = IN[0][0] + ' ' + str(a) + ':' + IN[0][2] + ':' + IN[0][3]
# ----------------------------------------
watch_6 = Watch(python_script_2)
code_block_2 = CodeBlock { ":"; }
code_block_3 = CodeBlock { "-"; }
replace = String.Replace(str=watch_6, searchFor=code_block_2, replaceWith=code_block_3)
code_block_4 = CodeBlock { "/"; }
replace_2 = String.Replace(str=replace, searchFor=code_block_4, replaceWith=code_block_3)
watch_7 = Watch(replace_2)
code_block_5 = CodeBlock { "z"; }
code_block_6 = CodeBlock { " "; }
join = String.Join(code_block_6, watch_7)
watch_8 = Watch(join)

# group: IFC Exporter
folder_filename_and_ifc_version = CodeBlock()
# ---------- folder_filename_and_ifc_version.designscript (12 lines) ----------
//Folder
"C:\\IFCexports";
//Filename
"test7";
//IFC Version
"IFC2x2";
"IFC2x3";
"IFC2x3CV2";
"IFC2x2";
"IFC4";
"IFCBCA";
"IFCCOBIE";
# ----------------------------------------
boolean = BoolSelector(false)
boolean_2 = BoolSelector(false)
ifc_export = Python(IN[0]=folder_filename_and_ifc_version.out0, IN[1]=watch_7, IN[2]=folder_filename_and_ifc_version.out3, IN[3]=boolean, IN[4]=boolean_2)
# ---------- ifc_export.python (83 lines) ----------
#python nodes in dynamo 0.7
#proposed by Nicklas Verdier Østergaard, nvo@niras.dk
#Based on tools.dwf by Julien Benoit @jbenoit44
#http://aecuandme.wordpress.com/
import clr
clr.AddReference('ProtoGeometry')
from Autodesk.DesignScript.Geometry import *
# Import ToDSType(bool) extension method
clr.AddReference("RevitNodes")
import Revit
clr.ImportExtensions(Revit.Elements)
# Import geometry conversion extension methods
clr.ImportExtensions(Revit.GeometryConversion)
# Import DocumentManager and TransactionManager
clr.AddReference("RevitServices")
import RevitServices
from RevitServices.Persistence import DocumentManager
from RevitServices.Transactions import TransactionManager
from System.Collections.Generic import *
# Import RevitAPI
clr.AddReference("RevitAPI")
import Autodesk
from Autodesk.Revit.DB import *

doc = DocumentManager.Instance.CurrentDBDocument
uiapp = DocumentManager.Instance.CurrentUIApplication
app = uiapp.Application
uidoc=DocumentManager.Instance.CurrentUIApplication.ActiveUIDocument

#The inputs to this node will be stored as a list in the IN variable.
#dataEnteringNode = IN

folder=UnwrapElement(IN[0])
name=UnwrapElement(IN[1])
fileversion = IN[2]
wallandcolumnsplitting = IN[3]
exportbasequantities = IN[4]


#IFCVersion=UnwrapElement(IN[2])

# Start Transaction
TransactionManager.Instance.EnsureInTransaction(doc)

options=IFCExportOptions()

#if fileversion != None:
#	options.FileVersion = fileversion
if fileversion == "IFC4":
	options.FileVersion = IFCVersion.IFC4
if fileversion == "IFC2x2":
	options.FileVersion = IFCVersion.IFC2x2
if fileversion == "IFC2x3":
	options.FileVersion = IFCVersion.IFC2x3
if fileversion == "IFC2x3":
	options.FileVersion = IFCVersion.IFC2x3CV2
if fileversion == "IFCBCA":
	options.FileVersion = IFCVersion.IFCBCA
if fileversion == "IFCCOBIE":
	options.FileVersion = IFCVersion.IFCCOBIE
if fileversion == "":
	options.FileVersion = IFCVersion.Default
	
	
options.WallAndColumnSplitting = wallandcolumnsplitting
options.ExportBaseQuantities = exportbasequantities
options.AddOption("ExportInternalRevitPropertySets","true")

#IFCVersion Version = (IFCVersion) Enum.Parse( typeof(IFCVersion), UnwrapElement(IN[2]), true );
#x.FileVersion = IFCVersion.IFC2x3CV2
if name is None:
	OUT= None
	
else:
	c=doc.Export(folder, name, options)
	
	# End Transaction
	TransactionManager.Instance.TransactionTaskDone()
	
	if fileversion == "":
		OUT="Defult settings used"
	else:
		OUT=c
# ----------------------------------------
watch_9 = Watch(ifc_export)
code_block_7 = CodeBlock { "IN[0] = Foldedr"; "IN[1]= Name"; "IN[2]=Fileversion"; "IN[3]=Wall and column splitting"; "IN[4]=exportbasequantities"; }

# group: Elimination of extra IFC files based on size and time (if size differnece is huge keep it; if not and if time difference is huge, keep it)
file_list_from_file_path = Custom[File List from File Path](DirectoryPath=folder_filename_and_ifc_version.out0, dummy=watch_9)
watch_10 = Watch(file_list_from_file_path.fileList)
sort = Python(IN[0]=watch_10)
# ---------- sort.python (13 lines) ----------
# lingkonn@gmail.com

x=IN[0]
import re
def sort(x): 
    convertText = lambda text: int(text) if text.isdigit() else text.lower() 
    Textkey = lambda key: [ convertText(c) for c in re.split('([0-9]+)', key) ] 
    return sorted(x, key = Textkey)
a = sort(x)
OUT=[]
for i in a:
	if 'log.' not in i and 'Log.' not in i:
		OUT.append(i)
# ----------------------------------------
watch_11 = Watch(sort)
get_file_sizes_from_file_path = Custom[Get File Sizes from File Path List](filePathList=watch_11)
watch_12 = Watch(get_file_sizes_from_file_path.fileSizesInBytes)
string_3 = StringInput("\")
split_2 = String.Split(watch_11, string_3)
watch_13 = Watch(split_2)
python_script_3 = Python(IN[0]=watch_13)
# ---------- python_script_3.python (10 lines) ----------
import clr
clr.AddReference('ProtoGeometry')
from Autodesk.DesignScript.Geometry import *
#The inputs to this node will be stored as a list in the IN variables.
dataEnteringNode = IN
OUT = []
#Assign your output to the OUT variable.
for i in IN[0]:
	if not("log" in i[-1]):
		OUT.append(i[-1][:-4])
# ----------------------------------------
watch_14 = Watch(python_script_3)
string_4 = StringInput(" ")
string_5 = StringInput("-")
split_3 = String.Split(watch_14, string_4, string_5)
watch_15 = Watch(split_3)
python_script_4 = Python(IN[0]=watch_12, IN[1]=watch_15)
# ---------- python_script_4.python (25 lines) ----------
import clr
clr.AddReference('ProtoGeometry')
from Autodesk.DesignScript.Geometry import *
#The inputs to this node will be stored as a list in the IN variables.
dataEnteringNode = IN

#Assign your output to the OUT variable.
OUT = True
if abs(IN[0][len(IN[0])-2] - IN[0][len(IN[0])-4]) < (0.0012)*IN[0][len(IN[0])-2] and len(IN[0]) > 2:
	a = 'Erase'
		
	if IN[1][-1][0] ==  IN[1][-2][0] and IN[1][-1][1] ==  IN[1][-2][1] and IN[1][-1][2] ==  IN[1][-2][2] and int(IN[1][-1][3]) -  int(IN[1][-2][3]) == 1 and int(IN[1][-1][4]) -  int(IN[1][-2][4]) > 0:
		a = 'Keep-minute'
	elif IN[1][-1][0] ==  IN[1][-2][0] and IN[1][-1][1] ==  IN[1][-2][1] and IN[1][-1][2] ==  IN[1][-2][2] and int(IN[1][-1][3]) - int(IN[1][-2][3]) > 1:
		a = 'Keep-hour'
	elif IN[1][-1][0] ==  IN[1][-2][0] and IN[1][-1][1] ==  IN[1][-2][1] and IN[1][-1][2] !=  IN[1][-2][2]:	
		a = 'Keep-year'
	elif IN[1][-1][0] ==  IN[1][-2][0] and IN[1][-1][1] !=  IN[1][-2][1]:	
		a = 'Keep-day'
	elif IN[1][-1][0] !=  IN[1][-2][0]:	
		a = 'Keep-month'
else:
	a = 'Keep-size'

OUT = a
# ----------------------------------------
watch_16 = Watch(python_script_4)
python_script_5 = Python(IN[0]=watch_11, IN[1]=watch_16, IN[2]=code_block.out2)
# ---------- python_script_5.python (15 lines) ----------
import clr
clr.AddReference('ProtoGeometry')
from Autodesk.DesignScript.Geometry import *

#The inputs to this node will be stored as a list in the IN variables.
#dataEnteringNode = IN
filepathlist=UnwrapElement(IN[0])
samesize=UnwrapElement(IN[1])

if samesize == 'Erase' and IN[2] == 'true':
	OUT = IN[0][len(IN[0])-4]

#Assign your output to the OUT variable.
else:
	OUT = 0
# ----------------------------------------
watch_17 = Watch(python_script_5)
delete = File.Delete(watch_17)
python_script_6 = Python(IN[0]=watch_11, IN[1]=watch_16, IN[2]=code_block.out2)
# ---------- python_script_6.python (14 lines) ----------
import clr
clr.AddReference('ProtoGeometry')
from Autodesk.DesignScript.Geometry import *

#The inputs to this node will be stored as a list in the IN variables.
#dataEnteringNode = IN
filepathlist=UnwrapElement(IN[0])
samesize=UnwrapElement(IN[1])

if samesize == 'Erase' and IN[2] == 'true':
	OUT = IN[0][len(IN[0])-3]
#Assign your output to the OUT variable.
else:
	OUT = 0
# ----------------------------------------
watch_18 = Watch(python_script_6)
delete_2 = File.Delete(watch_18)

# group: Element Selection Logger
string_from_object_3 = FromObject(code_block.out0)
string_6 = StringInput(":")
string_7 = StringInput(" ")
split_4 = String.Split(string_from_object_3, string_6, string_7)
watch_19 = Watch(split_4)
python_script_7 = Python(IN[0]=watch_19)  # same code as python_script_2
watch_20 = Watch(python_script_7)
string_8 = StringInput(":")
string_9 = StringInput("-")
replace_3 = String.Replace(str=watch_20, searchFor=string_8, replaceWith=string_9)
string_10 = StringInput("/")
replace_4 = String.Replace(str=replace_3, searchFor=string_10, replaceWith=string_9)
watch_21 = Watch(replace_4)
python_script_8 = Python(IN[0]=watch_21)
# ---------- python_script_8.python (29 lines) ----------
import clr

clr.AddReference ( "RevitAPIUI" ) 
from Autodesk.Revit.UI import *

clr.AddReference( "RevitServices " ) 
import RevitServices 
from RevitServices.Persistence import DocumentManager 
doc = DocumentManager.Instance.CurrentDBDocument 
uidoc=DocumentManager.Instance.CurrentUIApplication.ActiveUIDocument 

clr.AddReference("RevitNodes") 
import Revit 
clr.ImportExtensions(Revit.Elements)

elements = uidoc.Selection.GetElementIds() 

#OUT=[]
OUT = ''
for i in elements:
	OUT= OUT + str(i) + ',' + str(IN[0]) + '\n'
	
	
#sel = uidoc.Selection 
#obType = Selection.ObjectType.Element 
#ref = sel.PickObject(obType, "Select Element.")
#element = doc.GetElement(ref.ElementId) 

#OUT = element 
# ----------------------------------------
watch_22 = Watch(python_script_8)
flatten = List.Flatten(list=watch_22)  # unwired: amt
element_selection_logger = Python(IN[0]=watch_22)
# ---------- element_selection_logger.python (31 lines) ----------
# Original Script by EwanO 2018 (Sastrugi Package) 
# Use as you like :-)
# This code creates and appends items to a CSV file on the Desktop that
# lists elements fed to the input.

import clr
import System
from System.IO import Directory

import sys
# load python
#pyt_path = r'C:\Program Files (x86)\IronPython.2.7.8\Lib'
#sys.path.append(pyt_path)

#import os

## set the output directory and gather log data
#main_dir = 'C:\\Users'
#user = os.environ.get('USERNAME')
#dir = main_dir + '\\' + user + '\\Desktop'
dir = 'C:\\IFCexports'
# generate the file name for the log file
eid=IN[0]
filename = (str("Element_Log" + '.csv'))

# createss the log file (csv) and appends the input data.
fd = open(dir + '\\' + filename,'a')
fd.write(str(eid))
fd.close()

OUT = str("Element Logged")
# ----------------------------------------
